# Grasshopper definition data_tree.gh (Grasshopper 1.0.7)

# ---- group: M:1, N:N
panel = Panel("""X
Y
Z""")
panel_2 = Panel("""A
B
C""")
entwine = Entwine(Branch00=panel_2, Branch01=panel, FlattenInputs=True)
panel_3 = Panel("""1
2
3""")
concat = Concatenate(FragmentA=entwine, FragmentB=panel_3)
panel_4 = Panel(concat)

# ---- group: N:1
panel_5 = Panel("""A
B
C""")
concat_2 = Concatenate(FragmentA=panel_5, FragmentB="1")
panel_6 = Panel(concat_2)

# ---- group: M:M, N:1
panel_7 = Panel("""A
B
C""")
panel_8 = Panel("""X
Y
Z""")
entwine_2 = Entwine(Branch00="1", Branch01="7", FlattenInputs=True)
entwine_3 = Entwine(Branch00=panel_7, Branch01=panel_8, FlattenInputs=True)
concat_3 = Concatenate(FragmentA=entwine_3, FragmentB=entwine_2)
panel_9 = Panel(concat_3)

# ---- group: N:N
panel_10 = Panel("""A
B
C""")
panel_11 = Panel("""1
2
3""")
concat_4 = Concatenate(FragmentA=panel_10, FragmentB=panel_11)
panel_12 = Panel(concat_4)

# ---- group: M:M, N:N
panel_13 = Panel("""A
B
C""")
panel_14 = Panel("""X
Y
Z""")
panel_15 = Panel("""1
2
3""")
panel_16 = Panel("""7
8
9""")
entwine_4 = Entwine(Branch00=panel_13, Branch01=panel_14, FlattenInputs=True)
entwine_5 = Entwine(Branch00=panel_15, Branch01=panel_16, FlattenInputs=True)
concat_5 = Concatenate(FragmentA=entwine_4, FragmentB=entwine_5)
panel_17 = Panel(concat_5)
