# Grasshopper definition hari-kantsu.gh (Grasshopper 1.0.7)
# plug-ins: Karamba3D, treesloth01

# ---- group: 貫通孔2 位置
md_slider = MDSlider(
    SliderMode=0,
    slider_value=Point(0.5248126581, 0.4809332127, 0.5),
    x_domain=Domain(0, 1),
    y_domain=Domain(0, 1),
    z_domain=Domain(0, 1))
貫通孔2_径 = Slider(146, range=50..300)

# ---- group: 貫通孔1
md_slider_2 = MDSlider(
    SliderMode=0,
    slider_value=Point(0.2895828739, 0.3954880877, 0.5),
    x_domain=Domain(0, 1),
    y_domain=Domain(0, 1),
    z_domain=Domain(0, 1))
貫通孔1_径 = Slider(154, range=50..300)

# ----
梁せい = Slider(300, range=0..1000)
梁幅 = Slider(150, range=0..1000)
梁長 = Slider(3600, range=0..10000)
Z = UnitZ(Factor=1)
pt = Point(Point(0, 0, 0))
division = Division(A=梁幅, B=Slider(2, range=0..10))
line = LineSDL(Start=pt, Direction=Z, Length=梁せい)
end = EndPoints(Curve=line)  # -> Start, End
X = UnitX(Factor=division)
neg = Negative(Value=X)
move = Move(Geometry=[end.Start, end.End], Motion=X)  # -> Geometry, Transform
line_2 = LineSDL(Start=move.Geometry, Direction=neg, Length=梁幅)
Y = UnitY(Factor=梁長)
Y_2 = UnitY(Factor=梁長)
extr = Extrude(Base=line_2, Direction=Y)
extr_2 = Extrude(Base=line, Direction=Y_2)
number_slider = Slider(30, range=0..100)
フランジ = Brep(extr)
ウェブ = Brep(extr_2)
cluster = Cluster(srf=ウェブ, uv=md_slider_2, A=貫通孔1_径)
cluster_2 = Cluster(srf=cluster, uv=md_slider, A=貫通孔2_径)
ウェブ_貫通あり = Brep(cluster_2)

# ----
# 梁貫通なし
merge = Merge(Data1=フランジ, Data2=ウェブ)  # -> flatten(Result)
mesh_breps = MeshBrepsKaramba3D(
    Brep=merge,
    MeshResolution=number_slider,
    EdgeRefinementFactor=0.67,
    PointReduction=False,
    SmoothingStepSize=1,
    SmoothingIterations=5)  # -> Mesh, Info
Z_2 = UnitZ(Factor=Slider(10000, range=0..10000))
meshtoshell = MeshToShellKaramba3D(Mesh=mesh_breps.Mesh, LimitDistance_mm=0.005)  # -> Element, Points, Info
pdecon = Deconstruct(Point=meshtoshell.Points)  # -> XComponent, YComponent, ZComponent
larger = LargerThan(FirstNumber=pdecon.ZComponent, SecondNumber=Slider(0, range=0..100))  # -> LargerThan, OrEqualTo
smaller = SmallerThan(FirstNumber=pdecon.ZComponent, SecondNumber=梁せい)  # -> SmallerThan, OrEqualTo
smaller_2 = SmallerThan(FirstNumber=pdecon.YComponent, SecondNumber=Slider(0, range=0..100))  # -> SmallerThan, OrEqualTo
larger_2 = LargerThan(FirstNumber=pdecon.YComponent, SecondNumber=梁長)  # -> LargerThan, OrEqualTo
and = GateAnd(A=larger.LargerThan, B=smaller.SmallerThan)
and_2 = GateAnd(A=larger_2.OrEqualTo, B=and)
cull = CullPattern(List=meshtoshell.Points, CullPattern=larger_2.OrEqualTo)
cull_2 = CullPattern(List=meshtoshell.Points, CullPattern=and_2)
cull_3 = CullPattern(List=meshtoshell.Points, CullPattern=smaller_2.OrEqualTo)
loads = LoadsKaramba3D(ForceVector=Z_2, Local=False, PosInd=cull_2, LCase="0", mode="Point")
supp = SupportKaramba3D(PosInd=cull, menu=[buttons(on, on, off, off, off, off)])
supp_2 = SupportKaramba3D(PosInd=cull_3, menu=[buttons(on, on, on, off, off, off)])
support = SupportKaramba3D(flatten([supp_2, supp]))
load = LoadKaramba3D(loads)
assemble = AssembleModelKaramba3D(Elem=meshtoshell.Element, Support=support, Load=load, LimitDistance_mm=0.005)  # -> Model, Info, Mass_kg, CenterOfGravity, LoadCaseNames
analyze = AnalyzeKaramba3D(Model=assemble.Model)  # -> CalculatedModel, MaximumDisplacement_mm, ResultingForceOfGravity_N, ElasticEnergyChange_kNm
modelview = ModelViewKaramba3D(Model=analyze.CalculatedModel, ResultFactors=1, ResultCase=-1)  # -> Model, DeformedMesh, DeformedAxes, DeformedModel
shellview = ShellViewKaramba3D(Model=modelview.Model, IndexOfLayer=0)  # -> Model, MeshesOfRenderedShells, LegendColors, LegendTags
utilization = UtilizationOfElementsKaramba3D(AnalyzedModel=modelview.Model, mode="Shells")  # -> AnalyzedModel, flatten(Utilization)
legend = Legend(Colour=shellview.LegendColors, Tags=shellview.LegendTags, LegendType=1)
sort = SortList(Keys=utilization.Utilization)  # -> Keys, ValuesA
first_last = FirstLast(List=sort.Keys)  # -> FirstValue, LastValue

# ----
# 梁貫通あり
merge_2 = Merge(Data1=フランジ, Data2=ウェブ_貫通あり)  # -> flatten(Result)
mesh_breps_2 = MeshBrepsKaramba3D(
    Brep=merge_2,
    MeshResolution=number_slider,
    EdgeRefinementFactor=0.67,
    PointReduction=False,
    SmoothingStepSize=1,
    SmoothingIterations=5)  # -> Mesh, Info
Z_3 = UnitZ(Factor=Slider(10000, range=0..10000))
meshtoshell_2 = MeshToShellKaramba3D(Mesh=mesh_breps_2.Mesh, LimitDistance_mm=0.005)  # -> Element, Points, Info
pdecon_2 = Deconstruct(Point=meshtoshell_2.Points)  # -> XComponent, YComponent, ZComponent
larger_3 = LargerThan(FirstNumber=pdecon_2.ZComponent, SecondNumber=Slider(0, range=0..100))  # -> LargerThan, OrEqualTo
smaller_3 = SmallerThan(FirstNumber=pdecon_2.ZComponent, SecondNumber=梁せい)  # -> SmallerThan, OrEqualTo
smaller_4 = SmallerThan(FirstNumber=pdecon_2.YComponent, SecondNumber=Slider(0, range=0..100))  # -> SmallerThan, OrEqualTo
larger_4 = LargerThan(FirstNumber=pdecon_2.YComponent, SecondNumber=梁長)  # -> LargerThan, OrEqualTo
and_3 = GateAnd(A=larger_3.LargerThan, B=smaller_3.SmallerThan)
and_4 = GateAnd(A=larger_4.OrEqualTo, B=and_3)
cull_4 = CullPattern(List=meshtoshell_2.Points, CullPattern=larger_4.OrEqualTo)
cull_5 = CullPattern(List=meshtoshell_2.Points, CullPattern=and_4)
cull_6 = CullPattern(List=meshtoshell_2.Points, CullPattern=smaller_4.OrEqualTo)
loads_2 = LoadsKaramba3D(ForceVector=Z_3, Local=False, PosInd=cull_5, LCase="0", mode="Point")
supp_3 = SupportKaramba3D(PosInd=cull_4, menu=[buttons(on, on, off, off, off, off)])
supp_4 = SupportKaramba3D(PosInd=cull_6, menu=[buttons(on, on, on, off, off, off)])
load_2 = LoadKaramba3D(loads_2)
support_2 = SupportKaramba3D(flatten([supp_4, supp_3]))
assemble_2 = AssembleModelKaramba3D(Elem=meshtoshell_2.Element, Support=support_2, Load=load_2, LimitDistance_mm=0.005)  # -> Model, Info, Mass_kg, CenterOfGravity, LoadCaseNames
analyze_2 = AnalyzeKaramba3D(Model=assemble_2.Model)  # -> CalculatedModel, MaximumDisplacement_mm, ResultingForceOfGravity_N, ElasticEnergyChange_kNm
division_2 = Division(A=analyze_2.MaximumDisplacement_mm, B=analyze.MaximumDisplacement_mm)
modelview_2 = ModelViewKaramba3D(Model=analyze_2.CalculatedModel, ResultFactors=1, ResultCase=-1)  # -> Model, DeformedMesh, DeformedAxes, DeformedModel
shellview_2 = ShellViewKaramba3D(Model=modelview_2.Model, IndexOfLayer=0)  # -> Model, MeshesOfRenderedShells, LegendColors, LegendTags
utilization_2 = UtilizationOfElementsKaramba3D(AnalyzedModel=modelview_2.Model, mode="Shells")  # -> AnalyzedModel, flatten(Utilization)
legend_2 = Legend(Colour=shellview_2.LegendColors, Tags=shellview_2.LegendTags, LegendType=1)
sort_2 = SortList(Keys=utilization_2.Utilization)  # -> Keys, ValuesA
first_last_2 = FirstLast(List=sort_2.Keys)  # -> FirstValue, LastValue

変形量比 = Panel(division_2)
division_3 = Division(A=first_last_2.LastValue, B=first_last.LastValue)
最大応力比 = Panel(division_3)

# ==== cluster Cluster
srf = ClusterInput()
srf_2 = Surface(srf)
uv = ClusterInput()
evalsrf = EvaluateSurface(Surface=reparameterize(srf_2), Point=uv)  # -> Point, Normal, UDirection, VDirection, Frame
A = ClusterInput()
division = Division(A=A, B=Slider(2, range=0..10))
yz = YZPlane(Origin=evalsrf.Point)
cir = Circle(Plane=yz, Radius=division)
split = SplitBrep(Brep=srf_2, Cutter=cir)
area = Area(Geometry=split)  # -> Area, Centroid
sort = SortList(Keys=area.Area, ValuesA=split)  # -> Keys, ValuesA
first_last = FirstLast(List=sort.ValuesA)  # -> FirstValue, LastValue
L = ClusterOutput(first_last.LastValue)
