# Grasshopper definition simple-beam.gh (Grasshopper 1.0.7)
# plug-ins: Karamba3D

梁長_mm = Slider(1000, range=0..1000)
荷重位置 = Slider(0.755, range=0..1)
荷重_n = Slider(10, range=0..10)
荷重位置_2 = Slider(0.5, range=0..1)
梁長_mm_2 = Slider(1000, range=0..1000)
荷重_n_2 = Slider(10, range=0..10)
X = UnitX(Factor=1)
X_2 = UnitX(Factor=1)
pt = Point(Point(0, 0, 0))
pt_2 = Point(Point(0, 0, -658.466709))
multiplication = Multiplication(A=梁長_mm, B=荷重位置)
multiplication_2 = Multiplication(A=梁長_mm_2, B=荷重位置)
line = LineSDL(Start=pt, Direction=X, Length=梁長_mm)
line_2 = LineSDL(Start=pt_2, Direction=X_2, Length=梁長_mm_2)
end = EndPoints(Curve=line)  # -> Start, End
divlength = DivideLength(Curve=line, Length=multiplication)  # -> Points, Tangents, Parameters
end_2 = EndPoints(Curve=line_2)  # -> Start, End
divlength_2 = DivideLength(Curve=line_2, Length=multiplication_2)  # -> Points, Tangents, Parameters
item = ListItem(List=divlength.Points, Index=0, Wrap=True)  # -> Item, flatten(Item1)
item_2 = ListItem(List=divlength_2.Points, Index=0, Wrap=True)  # -> Item, flatten(Item1)
merge = Merge(Data1=end.Start, Data2=item.Item1, Data3=end.End)
merge_2 = Merge(Data1=end_2.Start, Data2=item_2.Item1, Data3=end_2.End)
neg = Negative(Value=荷重_n)
neg_2 = Negative(Value=荷重_n_2)
pline = PolyLine(Vertices=flatten(merge), Closed=False)
pline_2 = PolyLine(Vertices=flatten(merge_2), Closed=False)
Z = UnitZ(Factor=neg)
Z_2 = UnitZ(Factor=neg_2)
supp = SupportKaramba3D(PosInd=end.Start, menu=[buttons(on, on, on, on, off, off)])
supp_2 = SupportKaramba3D(PosInd=end.End, menu=[buttons(off, on, on, off, off, off)])
supp_3 = SupportKaramba3D(PosInd=end_2.Start, menu=[buttons(on, on, on, on, off, off)])
supp_4 = SupportKaramba3D(PosInd=end_2.End, menu=[buttons(off, on, on, off, off, off)])
linetobeam = LineToBeamKaramba3D(
    Line=pline,
    New=True,
    Remove=True,
    LimitDistance_mm=0.005,
    Bending=True,
    SetBucklingLength=True,
    ToPolylineMaxAngle=0.03,
    ToPolylineTolerance=0.01,
    ToPolylineMinEdgeLength=0.25)  # -> Element, Points, Info
loads = LoadsKaramba3D(ForceVector=Z, Local=False, PosInd=item.Item1, LCase="0", mode="Point")
linetobeam_2 = LineToBeamKaramba3D(
    Line=pline_2,
    New=True,
    Remove=True,
    LimitDistance_mm=0.005,
    Bending=True,
    SetBucklingLength=True,
    ToPolylineMaxAngle=0.03,
    ToPolylineTolerance=0.01,
    ToPolylineMinEdgeLength=0.25)  # -> Element, Points, Info
loads_2 = LoadsKaramba3D(ForceVector=Z_2, Local=False, PosInd=item_2.Item1, LCase="0", mode="Point")
assemble = AssembleModelKaramba3D(Elem=linetobeam.Element, Support=[supp, supp_2], Load=loads, LimitDistance_mm=0.005)  # -> Model, Info, Mass_kg, CenterOfGravity, LoadCaseNames
assemble_2 = AssembleModelKaramba3D(Elem=linetobeam_2.Element, Support=[supp_3, supp_4], Load=loads_2, LimitDistance_mm=0.005)  # -> Model, Info, Mass_kg, CenterOfGravity, LoadCaseNames
analyze = AnalyzeKaramba3D(Model=assemble.Model)  # -> CalculatedModel, MaximumDisplacement_mm, ResultingForceOfGravity_N, ElasticEnergyChange_kNm
analyze_2 = AnalyzeKaramba3D(Model=assemble_2.Model)  # -> CalculatedModel, MaximumDisplacement_mm, ResultingForceOfGravity_N, ElasticEnergyChange_kNm
modelview = ModelViewKaramba3D(Model=analyze.CalculatedModel, ResultFactors=1, ResultCase=-1)  # -> Model, DeformedMesh, DeformedAxes, DeformedModel
modelview_2 = ModelViewKaramba3D(Model=analyze_2.CalculatedModel, ResultFactors=1, ResultCase=-1)  # -> Model, DeformedMesh, DeformedAxes, DeformedModel
beamview = BeamViewKaramba3D(Model=modelview.Model)  # -> Model, MeshesOfRenderedBeams, DeformedBeamAxes, LegendColors, LegendTags
beamview_2 = BeamViewKaramba3D(Model=modelview_2.Model)  # -> Model, MeshesOfRenderedBeams, DeformedBeamAxes, LegendColors, LegendTags
