# Grasshopper definition CrossSectionOpt.gh (Grasshopper 1.0.7)
# plug-ins: karambaGH

X = UnitX(Factor=1)
pt = Point(Point(0, 0, 0))
range = Range(Domain=Domain(0, 1), Steps=Slider(6, range=1..20))
line = LineSDL(Start=pt, Direction=X, Length=Slider(20, range=1..30))
end = EndPoints(Curve=line)  # -> Start, End
readcstable = ReadCrossSectionTableFromFileKaramba3D(FilePathOfCrossSectionTable="Set CrossSection file Path")  # -> CrossSection, Info
neg = Negative(Value=Slider(300, range=0..300))
shatter = Shatter(Curve=line, Parameters=range)
Z = UnitZ(Factor=neg)
supp = SupportKaramba3D(PosInd=end.Start, menu=[buttons(on, on, on, on, on, on)])
crosecrselect = CrossSectionRangeSelectorKaramba3D(
    CrossSections=readcstable.CrossSection,
    MaximumHeight_cm=Slider(200, range=0..200),
    MaximumWidth_cm=Slider(42, range=0..100),
    menu=[dropdown(0), dropdown(0), dropdown(0)])
linetobeam = LineToBeamKaramba3D(Line=shatter, New=True, Remove=True, LimitDistance_m=0.005)  # -> Element, Points, Info
loads = LoadsKaramba3D(ForceVector=Z, Local=False, PosInd=end.End, LCase=0, mode="Point")
assemble = AssembleModelKaramba3D(Elem=linetobeam.Element, Support=supp, Load=loads, LimitDistance_m=0.005)  # -> Model, Info, Mass_kg, CenterOfGravity
c_script = CSharpScript(ModelIn=assemble.Model, CroSecsIn=crosecrselect, NIter=Slider(10, range=0..10), LcInd="0")  # -> Out, ModelOut, DispOut
panel = Panel(c_script.DispOut)
disassemble = DisassembleModelKaramba3D(Model=c_script.ModelOut)  # -> Model, Point, Beam, Shell, Support, Load, Line, Mesh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
modelview = ModelViewKaramba3D(Model=c_script.ModelOut, ResultFactors=1, ResultCase=-1)  # -> Model, DeformedMesh, DeformedAxes, DeformedModel
assemble_2 = AssembleModelKaramba3D(Elem=disassemble.Beam, Support=disassemble.Support, Load=disassemble.Load, LimitDistance_m=0.005)  # -> Model, Info, Mass_kg, CenterOfGravity
beamview = BeamViewKaramba3D(Model=modelview.Model)  # -> Model, MeshesOfRenderedBeams, DeformedBeamAxes, LegendColors, LegendTags
analyze = AnalyzeKaramba3D(Model=assemble_2.Model)  # -> CalculatedModel, MaximumDisplacement_cm, ResultingForceOfGravity_kN, ElasticEnergy_kNm
panel_2 = Panel(analyze.MaximumDisplacement_cm)
legend = Legend(Colour=beamview.LegendColors, Tags=beamview.LegendTags, LegendType=1)
