# Grasshopper definition column_model.gh (Grasshopper 1.0.7)
# plug-ins: karambaGH

pt = ConstructPoint(XCoordinate=0, YCoordinate=0, ZCoordinate=0)
Z = UnitZ(Factor=1)
number_slider = Slider(2.2, range=0..10)
number_slider_2 = Slider(30, range=0..100)
matselect = MaterialSelectionKaramba3D(Color=ColourSwatch(SwatchColor=RGB(255, 87, 87)), menu=[dropdown(1), dropdown(1)])
line = LineSDL(Start=pt, Direction=Z, Length=Slider(5, range=0..10))
Z_2 = UnitZ(Factor=Slider(10, range=0..10))
neg = Negative(Value=Z_2)
end = EndPoints(Curve=line)  # -> Start, End
cross_section = CrossSectionKaramba3D(
    FamilyNameOfCrossSection="DefaultCroSec",
    Material=matselect,
    Height_cm=number_slider_2,
    UpperFlangeWidth_cm=number_slider_2,
    LowerFlangeWidth_cm=number_slider_2,
    UpperFlangeThickness_cm=number_slider,
    LowerFlangeThickness_cm=number_slider,
    SidewallsThickness_cm=number_slider,
    FilletRadius_cm=Slider(5.5, range=0..10),
    mode="Box")
supp = SupportKaramba3D(PosInd=pt, menu=[buttons(on, on, on, on, on, on)])
loads = LoadsKaramba3D(ForceVector=neg, Local=False, PosInd=end.End, LCase=0, mode="Point")
linetobeam = LineToBeamKaramba3D(Line=line, Identifier="Column", CrossSection=cross_section, New=True, Remove=True, LimitDistance_m=0.005)  # -> Element, Points, Info
assemble = AssembleModelKaramba3D(Elem=linetobeam.Element, Support=supp, Load=loads, LimitDistance_m=0.005)  # -> Model, Info, Mass_kg, CenterOfGravity
analyze = AnalyzeKaramba3D(Model=assemble.Model)  # -> CalculatedModel, MaximumDisplacement_cm, ResultingForceOfGravity_kN, ElasticEnergy_kNm
modelview = ModelViewKaramba3D(Model=analyze.CalculatedModel, ResultFactors=1, ResultCase=-1)  # -> Model, DeformedMesh, DeformedAxes, DeformedModel
beamview = BeamViewKaramba3D(Model=modelview.Model)  # -> Model, MeshesOfRenderedBeams, DeformedBeamAxes, LegendColors, LegendTags
