# Grasshopper definition CrossSectionOpt.gh (Grasshopper 1.0.7)
# plug-ins: Karamba3D

X = UnitX(Factor=1)
pt = Point(Point(0, 0, 0))
number_slider = Slider(1000, range=0..1000)
range = Range(Domain=Domain(0, 1), Steps=Slider(6, range=1..20))
path = FilePath("C:\Users\hiroa\Desktop\DigitalFUTURES\Day2\data\JP_CrossSectionValues.csv")
line = LineSDL(Start=pt, Direction=X, Length=Slider(10000, range=0..10000))
readcstable = ReadCrossSectionTableFromFileKaramba3D(FilePathOfCrossSectionTable=path)  # -> CrossSection, Info
neg = Negative(Value=Slider(300000, range=0..300000))
shatter = Shatter(Curve=line, Parameters=range)
end = EndPoints(Curve=line)  # -> Start, End
Z = UnitZ(Factor=neg)
supp = SupportKaramba3D(PosInd=end.Start, menu=[buttons(on, on, on, on, on, on)])
linetobeam = LineToBeamKaramba3D(
    Line=shatter,
    New=True,
    Remove=True,
    LimitDistance_mm=0.005,
    Bending=True,
    SetBucklingLength=True,
    ToPolylineMaxAngle=0.03,
    ToPolylineTolerance=0.01,
    ToPolylineMinEdgeLength=0.25)  # -> Element, Points, Info
crosecrselect = CrossSectionRangeSelectorKaramba3D(
    CrossSections=readcstable.CrossSection,
    MaximumHeight_mm=number_slider,
    MaximumWidth_mm=number_slider,
    menu=[dropdown(0), dropdown(1), dropdown(2)])
loads = LoadsKaramba3D(ForceVector=Z, Local=False, PosInd=end.End, LCase="0", mode="Point")
assemble = AssembleModelKaramba3D(Elem=linetobeam.Element, Support=supp, Load=loads, LimitDistance_mm=0.005)  # -> Model, Info, Mass_kg, CenterOfGravity, LoadCaseNames
c_script = CSharpScript(
    modelIn=assemble.Model,
    croSecsIn=crosecrselect,
    nIter=Slider(10, range=0..10),
    lcName="0",
    Reference=["C:\Program Files\Rhino 7\Plug-ins\Karamba\karamba.gha", "C:\Program Files\Rhino 7\Plug-ins\Karamba\karambaCommon.dll"])  # -> out, modelOut, dispOut; inputs croSecsIn: list, nIter: Int32, lcName: String
# ---------- c_script: C# usings ----------
using System.Linq;

using Karamba.Models;
using Karamba.CrossSections;
using Karamba.Elements;
using Karamba.Results;
# ---------- c_script: C# ----------
    // modelIn と croSecIn は object 型として入力されているので、
    // ここで Karamba の型にキャスト
    var model = modelIn as Model;
    var croSecs = new List<CroSec_Beam>(croSecsIn.Count);
    croSecs.AddRange(croSecsIn.Select(item => item as CroSec_Beam));

    var k3d = new KarambaCommon.Toolkit();
    List<double> maxDisp;
    List<double> outG;
    List<double> outComp;
    string message;
    List<List<double>> N;
    List<List<double>> Q;
    List<List<double>> M;

    int i = 0;
    // nIterの分だけ断面の収束計算を行う
    while (i < nIter)
    {
      // 最初に解析を実行
      model = k3d.Algorithms.AnalyzeThI(model, out maxDisp, out outG, out outComp, out message);

      // ここから各要素の応力を取得してそれに対して断面の検討を行う
      for (int elemInd = 0; elemInd < model.elems.Count; elemInd++)
      {
        var beam = model.elems[elemInd] as ModelBeam;
        if (beam == null)
        {
          continue;
        }

        // 要素の応力を取得
        BeamResultantForces.solve(model, new List<string> { elemInd.ToString() }, lcName, 100, 1, out N, out Q, out M);

        // 断面検定
        foreach (CroSec_Beam croSec in croSecs)
        {
          beam.crosec = croSec;
          var maxSigma = Math.Abs(N[0][0]) / croSec.A + M[0][0] / croSec.Wely_z_pos;
          if (maxSigma < croSec.material.ft())
          {
            break;  // 断面が ft 以下になったら断面の変更を終了
          }
        }
      }

      // ここまでの処理で変更した断面を反映させて、解析モデルを再生成
      model.initMaterialCroSecLists();
      model.buildFEModel();

      // 次のステップへ
      i++;
    }

    // 最終モデルの確認用に最後の解析実行
    model = k3d.Algorithms.AnalyzeThI(model, out maxDisp, out outG, out outComp, out message);

    // 結果の出力
    dispOut = new GH_Number(maxDisp[0]);
    modelOut = new Karamba.GHopper.Models.GH_Model(model);
# ---------- end c_script ----------
panel = Panel(c_script.dispOut)
panel_2 = Panel(c_script.out)
modelview = ModelViewKaramba3D(Model=c_script.modelOut, ResultFactors=1, ResultCase=-1)  # -> Model, DeformedMesh, DeformedAxes, DeformedModel
disassemble = DisassembleModelKaramba3D(Model=c_script.modelOut)  # -> Model, Point, Beam, Shell, Support, Load, Line, Mesh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
beamview = BeamViewKaramba3D(Model=modelview.Model)  # -> Model, MeshesOfRenderedBeams, DeformedBeamAxes, LegendColors, LegendTags
assemble_2 = AssembleModelKaramba3D(Elem=disassemble.Beam, Support=disassemble.Support, Load=disassemble.Load, LimitDistance_mm=0.005)  # -> Model, Info, Mass_kg, CenterOfGravity, LoadCaseNames
legend = Legend(Colour=beamview.LegendColors, Tags=beamview.LegendTags, LegendType=1)
analyze = AnalyzeKaramba3D(Model=assemble_2.Model)  # -> CalculatedModel, MaximumDisplacement_cm, ResultingForceOfGravity_kN, ElasticEnergy_kNm
panel_3 = Panel(analyze.MaximumDisplacement_cm)
