# Grasshopper definition column_model.gh (Grasshopper 1.0.7)
# plug-ins: Karamba3D

number_slider = Slider(22, range=0..100)
pt = ConstructPoint(XCoordinate=0, YCoordinate=0, ZCoordinate=0)
number_slider_2 = Slider(300, range=0..1000)
matselect = MaterialSelectionKaramba3D(Color=ColourSwatch(SwatchColor=RGB(255, 87, 87)), menu=[dropdown(1), dropdown(1)])
Z = UnitZ(Factor=Slider(10, range=0..10))
Z_2 = UnitZ(Factor=1)
multiplication = Multiplication(A=number_slider, B=2.5)
neg = Negative(Value=Z)
supp = SupportKaramba3D(PosInd=pt, menu=[buttons(on, on, on, on, on, on)])
line = LineSDL(Start=pt, Direction=Z_2, Length=Slider(5000, range=0..10000))
end = EndPoints(Curve=line)  # -> Start, End
cross_section = CrossSectionKaramba3D(
    FamilyNameOfCrossSection="DefaultCroSec",
    Material=matselect,
    Height_mm=number_slider_2,
    UpperFlangeWidth_mm=number_slider_2,
    LowerFlangeWidth_mm=number_slider_2,
    UpperFlangeThickness_mm=number_slider,
    LowerFlangeThickness_mm=number_slider,
    SidewallsThickness_mm=number_slider,
    FilletRadius_mm=multiplication,
    mode="Box")
loads = LoadsKaramba3D(ForceVector=neg, Local=False, PosInd=end.End, LCase="0", mode="Point")
linetobeam = LineToBeamKaramba3D(
    Line=line,
    Identifier="Column",
    CrossSection=cross_section,
    New=True,
    Remove=True,
    LimitDistance_mm=0.005,
    Bending=True,
    SetBucklingLength=True,
    ToPolylineMaxAngle=0.03,
    ToPolylineTolerance=0.01,
    ToPolylineMinEdgeLength=0.25)  # -> Element, Points, Info
assemble = AssembleModelKaramba3D(Elem=linetobeam.Element, Support=supp, Load=loads, LimitDistance_mm=0.005)  # -> Model, Info, Mass_kg, CenterOfGravity, LoadCaseNames
analyze = AnalyzeKaramba3D(Model=assemble.Model)  # -> CalculatedModel, MaximumDisplacement_cm, ResultingForceOfGravity_kN, ElasticEnergy_kNm
modelview = ModelViewKaramba3D(Model=analyze.CalculatedModel, ResultFactors=1, ResultCase=-1)  # -> Model, DeformedMesh, DeformedAxes, DeformedModel
beamview = BeamViewKaramba3D(Model=modelview.Model)  # -> Model, MeshesOfRenderedBeams, DeformedBeamAxes, LegendColors, LegendTags
