# Grasshopper definition column_script.gh (Grasshopper 1.0.7)
# plug-ins: Karamba3D

c_script = CSharpScript(Reference=["C:\Program Files\Rhino 7\Plug-ins\Karamba\karambaCommon.dll", "C:\Program Files\Rhino 7\Plug-ins\Karamba\karamba.gha"])  # -> out, modelOut, maxDisp
# ---------- c_script: C# usings ----------
using System.Drawing;
using System.Linq;
using Karamba.Utilities;
using Karamba.Elements;
using Karamba.Geometry;
using Karamba.CrossSections;
using Karamba.Supports;
using Karamba.Materials;
using Karamba.Loads;
using Karamba.Models;
# ---------- c_script: C# ----------
    var logger = new MessageLogger();
    var k3d = new KarambaCommon.Toolkit();

    // karamba 用の line を作成
    // 名前が似ていますが、Point3 も Line3 の Karamba.Geometry の構造体です。
    var p0 = new Point3(0, 0, 0);
    var p1 = new Point3(0, 0, 5000);
    var L0 = new Line3(p0, p1);

    // 材料の作成
    string family = "Steel";
    string name = "SN400";
    double E = 210000000; // kN/m2
    double G = 80760000;  // kN/m2
    double gamma = 78.5;  // kN/m3
    double ft = 23.5;     // kN/m2
    var hypothesis = FemMaterial.FlowHypothesis.mises; // 降伏判定理論
    double alfa = 0; //熱膨張係数（使わないので 0）
    var material = new FemMaterial_Isotrop(family, name, E, G, G, gamma, ft, ft, hypothesis, alfa, Color.Brown);

    // 断面の作成
    double height = 300;  // cm
    double width = 300;
    double thickness = 22;
    double fillet = 2.5 * thickness;
    var croSec = new CroSec_Box("Box", "Box", null, null, material, height, width, width, thickness, thickness, thickness, fillet);

    // Beamを作成
    // 入力は、Line、Id、CrossSection
    var nodes = new List<Point3>();
    List<BuilderBeam> elems = k3d.Part.LineToBeam(L0, "column", croSec, logger, out nodes);

    // 境界条件の作成
    // 入力は、条件を指定する Point3 と各変位の拘束の Boolean
    Support support = k3d.Support.Support(p0, new List<bool>(){ true, true, true, true, true, true });
    var supports = new List<Support>(){ support };

    // 荷重の作成
    // 入力は、条件を指定するPoint3、荷重のベクトル、モーメントのベクトル、荷重ケース
    PointLoad pload = k3d.Load.PointLoad(p1, new Vector3(0, 0, -10));
    var ploads = new List<Load>(){ pload };

    double mass;  // 重量
    Point3 cog;  // 重心
    bool flag;
    string info;
    Model model = k3d.Model.AssembleModel(elems, supports, ploads, out info, out mass, out cog, out info, out flag);

    // 解析を実行
    List<double> maxDisps;  // m
    List<double> outG;
    List<double> outComp;
    string message;
    model = k3d.Algorithms.AnalyzeThI(model, out maxDisps, out outG, out outComp, out message);

    Print("max disp: " + maxDisps.Max() * 100);

    modelOut = new Karamba.GHopper.Models.GH_Model(model);
    maxDisp = maxDisps.Max() * 100;
# ---------- end c_script ----------
panel = Panel(c_script.maxDisp)
disassemble = DisassembleModelKaramba3D(Model=c_script.modelOut)  # -> Model, Point, Beam, Shell, Support, Load, Line, Mesh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
modelview = ModelViewKaramba3D(Model=c_script.modelOut, ResultFactors=1, ResultCase=-1)  # -> Model, DeformedMesh, DeformedAxes, DeformedModel
disassemble_2 = DisassembleElementKaramba3D(Element=disassemble.Beam)  # -> Element, ElementIdentifier, AxisOfElement, CrossSection, Joint, Material, LocalCoordinateSystem, ElementIsActive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
beamview = BeamViewKaramba3D(Model=modelview.Model)  # -> Model, MeshesOfRenderedBeams, DeformedBeamAxes, LegendColors, LegendTags
disassemble_3 = DisassembleCrossSectionKaramba3D(CroSec=disassemble_2.CrossSection)  # -> CrossSection, FamilyNameOfCrossSection, TypeNameOfCrossSection, ElemIdentifiers, Color, Material, LocalEccentricity_mm, Heights_mm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
panel_2 = Panel(disassemble_3.Heights_mm)
