# Grasshopper definition integration_hops_karamba.gh (Grasshopper 1.0.7)
# plug-ins: Karamba3D, Hops

X = UnitX(Factor=1)
pt = Point(Point(0, 0, 0))
multiplication = Multiplication(A=Slider(10, range=0..10), B=Slider(1000, range=0..1000))
range = Range(Domain=Domain(0, 1), Steps=Slider(6, range=1..20))
line = LineSDL(Start=pt, Direction=X, Length=Slider(1000, range=0..10000))
neg = Negative(Value=multiplication)
cross_section = CrossSectionKaramba3D(
    FamilyNameOfCrossSection="DefaultCroSec",
    Material=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,
    Height_mm=96,
    UpperFlangeWidth_mm=100,
    LowerFlangeWidth_mm=100,
    UpperFlangeThickness_mm=8,
    LowerFlangeThickness_mm=8,
    WebThickness_mm=5,
    FilletRadius_mm=0,
    mode="I")
end = EndPoints(Curve=line)  # -> Start, End
shatter = Shatter(Curve=line, Parameters=range)
Z = UnitZ(Factor=neg)
supp = SupportKaramba3D(PosInd=end.Start, menu=[buttons(on, on, on, on, on, on)])
loads = LoadsKaramba3D(ForceVector=Z, Local=False, PosInd=end.End, LCase="0", mode="Point")
linetobeam = LineToBeamKaramba3D(
    Line=shatter,
    Identifier="beam",
    CrossSection=cross_section,
    New=True,
    Remove=True,
    LimitDistance_mm=0.005,
    Bending=True,
    SetBucklingLength=True,
    ToPolylineMaxAngle=0.03,
    ToPolylineTolerance=0.01,
    ToPolylineMinEdgeLength=0.25)  # -> Element, Points, Info
assemble = AssembleModelKaramba3D(Elem=linetobeam.Element, Support=supp, Load=loads, LimitDistance_mm=0.005)  # -> Model, Info, Mass_kg, CenterOfGravity, LoadCaseNames
c_script = CSharpScript(
    modelIn=assemble.Model,
    beamId="beam",
    Reference=["C:\Program Files\Rhino 7\Plug-ins\Karamba\karamba.gha", "C:\Program Files\Rhino 7\Plug-ins\Karamba\karambaCommon.dll"])  # -> out, modelOut, sectionName, length, moment; inputs beamId: list of String
# ---------- c_script: C# usings ----------
using System.Linq;

using Karamba.Models;
using Karamba.CrossSections;
using Karamba.Elements;
using Karamba.Results;
# ---------- c_script: C# ----------
    // modelIn と croSecIn は object 型として入力されているので、
    // ここで Karamba の型にキャスト
    var model = modelIn as Model;

    var k3d = new KarambaCommon.Toolkit();
    List<double> maxDisp;
    List<double> outG;
    List<double> outComp;
    string message;
    List<List<double>> N;
    List<List<double>> Q;
    List<List<double>> M;

    List<string> name = new List<string>();
    List<double> beamLength = new List<double>();
    List<double> stress = new List<double>();

    // 最初に静解析を実行
    model = k3d.Algorithms.AnalyzeThI(model, out maxDisp, out outG, out outComp, out message);

    // 要素ごとに応力を取得
    for (int elemInd = 0; elemInd < model.elems.Count; elemInd++)
    {
      var beam = model.elems[elemInd] as ModelBeam;
      if (beam == null)
      {
        continue;
      }

      // 要素の応力を評価して出力にセット
      BeamResultantForces.solve(model, new List<string> { elemInd.ToString() }, "-1", 10000, 1, out N, out Q, out M);
      stress.Add(M[0][0] / 1000000); //単位換算 Nmm → kNm

      // 断面名称を取得
      var crosec = beam.crosec as CroSec_I;
      if (crosec == null)
      {
        Component.AddRuntimeMessage(GH_RuntimeMessageLevel.Error, "断面が H ではありません");
        return;
      }
      name.Add("H-" + crosec.getHeight() + "*" + crosec.maxWidth() + "*" + crosec.w_thick + "*" + crosec.uf_thick);

      // 部材長の取得
      // 計算の値は m なので単位換算している
      beamLength.Add(beam.elementLength(model) / 1000);
    }

    // 結果の出力
    modelOut = new Karamba.GHopper.Models.GH_Model(model);
    sectionName = name;
    length = beamLength;
    moment = stress;
# ---------- end c_script ----------
modelview = ModelViewKaramba3D(Model=c_script.modelOut, ResultFactors=1, ResultCase=-1)  # -> Model, DeformedMesh, DeformedAxes, DeformedModel
hops = Hops(
    Name=c_script.sectionName,
    Lb=Slider(1, range=0..1),
    Moment=c_script.moment,
    M2_m1=Slider(1, range=0..10),
    CacheResultsInMemory=True,
    CacheSolveResults=True,
    RemoteDefinitionLocation="http://127.0.0.1:5000/moment",
    RemoteSolveVersion=(0, 1, 0),
    ShowInput_Enabled=False,
    ShowInput_Path=False,
    SynchronousSolve=True)  # -> Result, Ma
midpt = CurveMiddle(Curve=shatter)
b_forces = BeamForcesKaramba3D(AnalyzedModel=modelview.Model, Ts=[0, 1])  # -> AnalyzedModel, NormalForce_N, ShearForceVz_N, ShearForceVy_N, BendingMomentMt_kNm, BendingMomentMy_kNm, BendingMomentMz_kNm
beamview = BeamViewKaramba3D(Model=modelview.Model)  # -> Model, MeshesOfRenderedBeams, DeformedBeamAxes, LegendColors, LegendTags
検定比 = Panel(hops.Result)
tag = TextTag(Location=midpt, Text=hops.Result, Colour=ColourSwatch(SwatchColor=RGB(0, 0, 0)))
panel = Panel(b_forces.BendingMomentMy_kNm)
legend = Legend(Colour=beamview.LegendColors, Tags=beamview.LegendTags, LegendType=1)
