# Grasshopper definition move_brep.gh (Grasshopper 1.0.7)

number_slider = Slider(32, range=0..100)
number_slider_2 = Slider(7, range=0..10)
pt = Point(Point(0, 0, 0))
pt_2 = Point(Point(30.14326134, 33.14715677, 10.28546255))
box = Box2Pt(PointA=pt, PointB=pt_2, Plane=PlaneXY(0, 0, 0))

series = Series(Start=0, Step=number_slider, Count=number_slider_2)
Z = UnitZ(Factor=series)
move = Move(Geometry=box, Motion=Z)  # -> Geometry, Transform

c_script = CSharpScript(brep=box, n=number_slider, c=number_slider_2)  # -> out, A; inputs brep: Brep, n: Double, c: Int32
# ---------- c_script: C# ----------
    var result = new List<Brep>();
    for(var i = 0;i < c; i++)
    {
      Brep dupBrep = brep.DuplicateBrep();
      result.Add(dupBrep);
      brep.Translate(0, 0, n);
    }
    
    A = result;
# ---------- end c_script ----------
