# Grasshopper definition ShellOpt.gh (Grasshopper 1.0.7)
# plug-ins: Karamba3D, Tunny Info

genes = GenePool(
    Decimals=0,
    Maximum=1500,
    Minimum=500,
    Value=[885.2715559, 564.3201915, 818.40154, 698.6850916, 885.1199391, 1244.010902, 1286.685615, 1329.550804, 954.8852915, 905.1318021])

# ---- group: 外形の参考
number_slider = Slider(3000, range=0..3000)
rectangle = Rectangle(Plane=PlaneXY(0, 0, 0), XSize=number_slider, YSize=number_slider, Radius=0)  # -> Rectangle, Length

# ----
crv = Curve(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)
moveheight = GetNumber(genes, AtLeast=1, AtMost=1, Maximum=1.797693135e+308, Minimum=-1.797693135e+308, TreeAccess=True)
project = Project(Geometry=crv, Plane=PlaneXY(0, 0, 0))  # -> Geometry, Transform
neg = Negative(Value=Slider(300, range=0..1000))
offset = OffsetCurve(Curve=project.Geometry, Distance=neg, Corners=4)
Z = UnitZ(Factor=moveheight)
boundary = BoundarySurfaces(Edges=offset)
popgeo = PopulateGeometry(Geometry=boundary, Count=Slider(10, range=0..100), Seed=Slider(9, range=0..100))
pipe = Pipe(Curve=crv, Radius=Slider(100, range=0..100), Caps=1)
move = Move(Geometry=popgeo, Motion=Z)  # -> Geometry, Transform
patch = Patch(Curves=crv, Points=move.Geometry, Spans=Slider(50, range=0..100), Flexibility=Slider(10, range=0..100), Trim=True)
matselect = MaterialSelectionKaramba3D(menu=[dropdown(7), dropdown(5)])
cross_section = CrossSectionKaramba3D(FamilyNameOfCrossSection="DefaultCroSec", Materials=matselect, Heights_mm=Slider(150, range=0..1000), mode="Shell - Var")
mesh_breps = MeshBrepsKaramba3D(
    Brep=patch,
    MeshResolution=Slider(100, range=0..1000),
    EdgeRefinementFactor=0.67,
    PointReduction=False,
    SmoothingStepSize="1",
    SmoothingIterations=5)  # -> Mesh, Info

# ---- group: RH_OUT:Brep
brep = Brep(patch)

# ----
meshtoshell = MeshToShellKaramba3D(Mesh=mesh_breps.Mesh, CrossSection=cross_section, LimitDistance_mm=0.005)  # -> Element, Points, Info
preview = CustomPreview(Geometry=patch, Material=ColourSwatch(SwatchColor=RGBA(255, 255, 255, 124)))
pdecon = Deconstruct(Point=meshtoshell.Points)  # -> XComponent, YComponent, ZComponent
smaller = SmallerThan(FirstNumber=pdecon.ZComponent, SecondNumber=Slider(10, range=-20..10))  # -> SmallerThan, OrEqualTo
brepinc = PointInBrep(Brep=pipe, Point=meshtoshell.Points, Strict=False)
and = GateAnd(A=smaller.SmallerThan, B=brepinc)
cull = CullPattern(List=meshtoshell.Points, CullPattern=and)
supp = SupportKaramba3D(PosInd=cull, menu=[buttons(on, on, on, off, off, off)])
loads = LoadsKaramba3D(Vector=Vector(0, 0, -1), LCase="0", mode="Gravity")
assemble = AssembleModelKaramba3D(Elem=meshtoshell.Element, Support=supp, Load=loads, LimitDistance_mm=0.005)  # -> Model, Info, Mass_kg, CenterOfGravity, LoadCaseNames
analyze = AnalyzeKaramba3D(Model=assemble.Model)  # -> CalculatedModel, MaximumDisplacement_mm, ResultingForceOfGravity_N, ElasticEnergyChange_kNm

# ---- group: RH_OUT:DEnergy
num = Number(analyze.ElasticEnergyChange_kNm)

# ----
modelview = ModelViewKaramba3D(Model=analyze.CalculatedModel, ResultFactors=1, ResultCase=-1)  # -> Model, DeformedMesh, DeformedAxes, DeformedModel
tunny = Tunny(Variables=genes, Objectives=num)
galapagos = Galapagos(fitness=analyze, gene=genes)
shellview = ShellViewKaramba3D(Model=modelview.Model, IndexOfLayer=0)  # -> Model, MeshesOfRenderedShells, LegendColors, LegendTags
